# Grasshopper definition BASIC_07_Casting_methods.gh (Grasshopper 1.0.7)
# plug-ins: Robot Components

# ----
# License info
I = Info()
panel = Panel(I)

# ----
# Actions
# Action and Action Group
toggle = BooleanToggle(False)
sdo = SetDigitalOutput(Name="DO_01", State=Toggle(True))
wt = WaitForTime(InPosition=toggle, Duration="2.0")
merge = Merge(Data1=wt, Data2=sdo, Data3=wt)
group = Group(Objects=merge)
A = Action(group)
ag = ActionGroup(group)
ungroup = UngroupActions(ActionGroup=ag)
panel_2 = Panel(A)
panel_3 = Panel(ungroup)

# ----
# Declarations
# External Joint Position
panel_4 = Panel("[9E9, 867.5, 893.2, 9E9, 9E9, 9E9]")
panel_5 = Panel("LOCAL CONST extjoint pos2 := [9E9, 9E9, 9E9, 9E9, 9E9, 456.7];")
merge_2 = Merge(
    Data1=Slider(450.5, range=0..1000),
    Data2=panel_4,
    Data3="CONST extjoint pos1 := [9E9, 9E9, 9E9, 9E9, 6001.97, 9E9];",
    Data4=panel_5)
ej = ExternalJointPosition(merge_2)
panel_6 = Panel(ej)

# ----
# Robot Joint Position
panel_7 = Panel("0.0, 0.0, 0.0, 0.0, 45.0, 0.0")
panel_8 = Panel("TASK VAR robjoint pos4 := [0.0, -45.0, 45.0, 0.0, 45.0, 0.0];")
merge_3 = Merge(Data1=panel_7, Data2="CONST robjoint pos3 := [45.0, 0.0, 0.0, 90.0, 45.0, 0.0];", Data3=panel_8)
rj = RobotJointPosition(merge_3)
panel_9 = Panel(rj)

# ----
# Target
panel_10 = Panel("LOCAL CONST jointtarget target3 := [[0, 30, -30, 0, 45, 0], [9E9, 9E9, 9E9, 9E9, 9E9, 9E9]];")
panel_11 = Panel("[[0, 30, -30, 0, 45, 0], [9E9, 9E9, 300.45, 9E9, 9E9, 9E9]]")
panel_12 = Panel("[[500.54, -343.13, 89.98], [0.707107, 0.707107, 0, 0], [0,0,0,0], [9E9, 9E9, 9E9, 9E9, 9E9, 9E9]]")
panel_13 = Panel("VAR robtarget target4 := [[500.54, -343.13, 89.98], [0.707107, 0.707107, 0, 0], [0,0,0,0], [9E9, 9E9, 9E9, 9E9, 9E9, 9E9]];")
xy = XYPlane(Origin=Point(0, 0, 0))
rt = RobotTarget(Plane=xy, AxisConfiguration=0, Set_External_Joint_Position=False, Set_Reference_Plane=False)
jt = JointTarget()
pt = ConstructPoint(
    XCoordinate=Slider(-217, range=-1000..1000),
    YCoordinate=Slider(323, range=-1000..1000),
    ZCoordinate=Slider(-18, range=-1000..1000))
xy_2 = XYPlane(Origin=Point(0, 0, 0))
merge_4 = Merge(
    Data1=rt,
    Data2=jt,
    Data3=xy_2,
    Data4=pt,
    Data5=panel_10,
    Data6=panel_11,
    Data7="0, 0, 0, 0, 45, 0",
    Data8=panel_13,
    Data9=panel_12)
T = Target(merge_4)
jt_2 = JointTarget(T)
rt_2 = RobotTarget(T)
ej_2 = ExternalJointPosition(T)
panel_14 = Panel(jt_2)
panel_15 = Panel(rt_2)
panel_16 = Panel(ej_2)

# ----
# Joint Target
panel_17 = Panel("LOCAL CONST jointtarget target1 := [[0, 30, -30, 0, 45, 0], [9E9, 9E9, 9E9, 9E9, 9E9, 9E9]];")
rj_2 = RobotJointPosition(
    RobotJointPosition1=0,
    RobotJointPosition2=0,
    RobotJointPosition3=0,
    RobotJointPosition4=0,
    RobotJointPosition5=0,
    RobotJointPosition6=0)
merge_5 = Merge(Data1=rj_2, Data2=panel_17, Data3="[0, 0, 0, 0, 90, 0], [9E9, 9E9, 300.45, 9E9, 9E9, 9E9]", Data4="0, 0, 0, 0, 45, 0")
jt_3 = JointTarget(merge_5)
rj_3 = RobotJointPosition(jt_3)
ej_3 = ExternalJointPosition(jt_3)
panel_18 = Panel(rj_3)
panel_19 = Panel(ej_3)

# ----
# Robot Target
panel_20 = Panel("VAR robtarget target2 := [[500.54, -343.13, 89.98], [0.707107, 0.707107, 0, 0], [0,0,0,0], [9E9, 6000, 9E9, 9E9, 9E9, 9E9]];")
panel_21 = Panel("[[500.54, -343.13, 89.98], [0.707107, 0.707107, 0, 0], [0,0,0,0], [2400.1, 9E9, 9E9, 9E9, 9E9, 9E9]]")
pt_2 = ConstructPoint(
    XCoordinate=Slider(-217, range=-1000..1000),
    YCoordinate=Slider(323, range=-1000..1000),
    ZCoordinate=Slider(-18, range=-1000..1000))
xy_3 = XYPlane(Origin=Point(0, 0, 0))
merge_6 = Merge(Data1=xy_3, Data2=pt_2, Data3=panel_21, Data4=panel_20)
rt_3 = RobotTarget(merge_6)
pln = Plane(rt_3)
ej_4 = ExternalJointPosition(rt_3)
pt_3 = Point(rt_3)
panel_22 = Panel(ej_4)
panel_23 = Panel(pt_3)
panel_24 = Panel(pln)

# ----
# Speed Data
panel_25 = Panel("VAR speeddata speed1 := [5, 500, 5000, 1000];")
list = ValueList({"v5": 5, "v10": 10, "v20": 20, "v30": 30, "v40": 40, "v50": 50, "v60": 60, "v80": 80, "v100": 100, "v150": 150, "v200": 200, "v300": 300, "v400": 400, "v500": 500, "v600": 600, "v800": 800, "v1000": 1000, "v1500": 1500, "v2000": 2000, "v2500": 2500, "v3000": 3000, "v4000": 4000, "v5000": 5000, "v6000": 6000, "v7000": 7000}, selected="v5")
merge_7 = Merge(Data1=list, Data2="v100", Data3="200", Data4=panel_25, Data5="150.5, 500, 5000, 1000")
sd = SpeedData(merge_7)
panel_26 = Panel(sd)

# ----
# Zone Data
panel_27 = Panel("LOCAL CONST zonedata zone1 := [FALSE, 5, 8, 8, 0.8, 8, 0.8];")
list_2 = ValueList({"z0": 0, "z1": 1, "z5": 5, "z10": 10, "z15": 15, "z20": 20, "z30": 30, "z40": 40, "z50": 50, "z60": 60, "z80": 80, "z100": 100, "z150": 150, "z200": 200, "fine": -1}, selected="z1")
merge_8 = Merge(Data1=list_2, Data2="z1", Data3="10", Data4=panel_27, Data5="FALSE, 1, 2, 6, 1.6, 16, 1.8")
zd = ZoneData(merge_8)
panel_28 = Panel(zd)

# ----
# Move
panel_29 = Panel("LOCAL CONST jointtarget target3 := [[0, 30, -30, 0, 45, 0], [9E9, 9E9, 9E9, 9E9, 9E9, 9E9]];")
panel_30 = Panel("[[0, 30, -30, 0, 45, 0], [9E9, 9E9, 300.45, 9E9, 9E9, 9E9]]")
panel_31 = Panel("VAR robtarget target4 := [[500.54, -343.13, 89.98], [0.707107, 0.707107, 0, 0], [0,0,0,0], [9E9, 9E9, 9E9, 9E9, 9E9, 9E9]];")
panel_32 = Panel("[[500.54, -343.13, 89.98], [0.707107, 0.707107, 0, 0], [0,0,0,0], [9E9, 9E9, 9E9, 9E9, 9E9, 9E9]]")
xy_4 = XYPlane(Origin=Point(0, 0, 0))
rt_4 = RobotTarget(Plane=xy_4, AxisConfiguration=0, Set_External_Joint_Position=False, Set_Reference_Plane=False)
jt_4 = JointTarget()
xy_5 = XYPlane(Origin=Point(0, 0, 0))
merge_9 = Merge(
    Data1=jt_4,
    Data2=rt_4,
    Data3=xy_5,
    Data4=panel_29,
    Data5=panel_30,
    Data6="0, 0, 0, 0, 45, 0",
    Data7=panel_31,
    Data8=panel_32)
M = Movement(merge_9)
jt_5 = JointTarget(M)
rt_5 = RobotTarget(M)
wo = WorkObject(M)
pt_4 = Point(M)
T_2 = Target(M)
sd_2 = SpeedData(M)
zd_2 = ZoneData(M)
ej_5 = ExternalJointPosition(M)
rt_6 = RobotTool(M)
do = DigitalOutput(M)
pln_2 = Plane(M)
panel_33 = Panel(jt_5)
panel_34 = Panel(rt_5)
panel_35 = Panel(sd_2)
panel_36 = Panel(ej_5)
panel_37 = Panel(wo)
panel_38 = Panel(do)
panel_39 = Panel(T_2)
panel_40 = Panel(zd_2)
panel_41 = Panel(rt_6)
panel_42 = Panel(pln_2)
panel_43 = Panel(pt_4)

# ----
# Overwrite Robot Tool
robtool = RobotTool(
    Name="tool1",
    AttachmentPlane=PlaneXY(0, 0, 0),
    ToolPlane=PlaneXY(0, 0, 0),
    Set_Center_of_Gravity=False,
    Set_Mass=False,
    Set_Moment_of_Inertia=False)
ort = OverrideRobotTool(robtool)
rt_7 = RobotTool(ort)
panel_44 = Panel(rt_7)

# ----
# Instructions
# Set Analog Output
number_slider = Slider(4.9, range=0..10)
sao = SetAnalogOutput(Name="AO_01", Value=number_slider)
ao = AnalogOutput(sao)
num = Number(ao)
panel_45 = Panel(num)

# ----
# Joint Configuration Control
toggle_2 = BooleanToggle(True)
jccp = JointConfigurationControl(toggle_2)
bool = Boolean(jccp)
panel_46 = Panel(bool)

# ----
# Linear Configuration Control
toggle_3 = BooleanToggle(False)
lccp = LinearConfigurationControl(toggle_3)
bool_2 = Boolean(lccp)
panel_47 = Panel(bool_2)

# ----
# Wait for Time
number_slider_2 = Slider(2, range=0..10)
wt_2 = WaitForTime(number_slider_2)
num_2 = Number(wt_2)
bool_3 = Boolean(wt_2)
panel_48 = Panel(num_2)
panel_49 = Panel(bool_3)

# ----
# Wait for Analog Input
number_slider_3 = Slider(4.9, range=0..10)
list_3 = ValueList({"LT": 0, "GT": 1}, selected="GT")
wai = WaitForAnalogInput(Name="AI_01", Value=number_slider_3, Inequalty=list_3)
wai_2 = WaitForAnalogInput(wai)
num_3 = Number(wai_2)
panel_50 = Panel(num_3)

# ----
# Set Digital Output
toggle_4 = BooleanToggle(True)
sdo_2 = SetDigitalOutput(Name="DO_01", State=toggle_4)
do_2 = DigitalOutput(sdo_2)
bool_4 = Boolean(do_2)
panel_51 = Panel(bool_4)

# ----
# Wait for Digital Input
toggle_5 = BooleanToggle(True)
wdi = WaitForDigitalInput(Name="DI_01", State=toggle_5)
wdi_2 = WaitForDigitalInput(wdi)
bool_5 = Boolean(wdi_2)
panel_52 = Panel(bool_5)

# ----
# Comment
panel_53 = Panel("Comment (instruction by default)")
C = Comment(panel_53)
panel_54 = Panel(C)

# ----
# Dynamic
# Code Line
panel_55 = Panel("! Custom code line (instruction by default)")
clp = CodeLine(panel_55)
panel_56 = Panel(clp)

# ----
# Task List
panel_57 = Panel("PERS tasks my_tasks{2} := [[\"T_ROB1\"], [\"T_ROB2\"]];")
tl = TaskList(panel_57)
panel_58 = Panel(tl)

# ----
# Wait Sync Task
wst = WaitSyncTask()

# ----
# Multi Move
# Sync Move On
smon = SyncMoveOn()

# ----
# Sync Move Off
smoff = SyncMoveOff()

# ----
# Robot Tool
panel_59 = Panel("PERS tooldata parallel_gripper := [TRUE, [[215.448, 3.171, 102.332], [0.5, 0.5, 0.5, 0.5]], [0.001, [0, 0, 0.001], [1, 0, 0, 0], 0, 0, 0]];")
rt_8 = RobotTool(panel_59)
mesh = Mesh(rt_8)
pln_3 = Plane(rt_8)
pt_5 = Point(rt_8)
vec = Vector(rt_8)
panel_60 = Panel(mesh)
panel_61 = Panel(pln_3)
panel_62 = Panel(pt_5)
panel_63 = Panel(vec)

# ----
# Work Object
panel_64 = Panel("PERS wobjdata wobj1 := [FALSE, TRUE, \"\", [[0, 0, 0], [1, 0, 0, 0]], [[0.0009, -0.0082, 8.0304], [0.9999999, 0.0005131, 0.0000556, 0]]];")
wo_2 = WorkObject(panel_64)
ea = ExternalAxis(wo_2)
pln_4 = Plane(wo_2)
pt_6 = Point(wo_2)
panel_65 = Panel(ea)
panel_66 = Panel(pln_4)
panel_67 = Panel(pt_6)

# ----
# External Axis
number_slider_4 = Slider(2, range=0..10)
# Definitions
panel_68 = Panel("linear_axis")
xy_6 = XYPlane(Origin=Point(0, 0, 0))
xy_7 = XYPlane(Origin=Point(0, 0, 0))
Z = UnitZ(Factor=1)
external_rotational_axis = ExternalRotationalAxis(Name="rotational_axis", AxisPlane=xy_6, AxisLimits="-360 To 360", Set_Axis_Logic_Number=False, Set_Moves_Robot=False)
external_linear_axis = ExternalLinearAxis(
    Name=panel_68,
    AttachmentPlane=xy_7,
    Axis=Z,
    AxisLimits="0 To 1000",
    AxisLogicNumber=number_slider_4,
    MovesRobot=Toggle(True),
    Set_Axis_Logic_Number=True,
    Set_Moves_Robot=True)
merge_10 = Merge(Data1=external_linear_axis, Data2=external_rotational_axis)
ea_2 = ExternalAxis(merge_10)
pln_5 = Plane(ea_2)
pt_7 = Point(ea_2)
vec_2 = Vector(ea_2)
bool_6 = Boolean(ea_2)
domain = Domain(ea_2)
num_4 = Number(ea_2)
panel_69 = Panel(bool_6)
panel_70 = Panel(pln_5)
panel_71 = Panel(pt_7)
panel_72 = Panel(vec_2)
panel_73 = Panel(domain)
panel_74 = Panel(num_4)

# ----
# Robot
irb1010 = ABBIRB101015037(PositionPlane=PlaneXY(0, 0, 0))
R = Robot(irb1010)
rt_9 = RobotTool(R)
panel_75 = Panel(rt_9)

# ----
# Mechanical Unit
mu = MechanicalUnit()

# ----
# External Rotational Axis
panel_76 = Panel("rotational_axis")
xy_8 = XYPlane(Origin=Point(0, 0, 0))
external_rotational_axis_2 = ExternalRotationalAxis(
    Name=panel_76,
    AxisPlane=xy_8,
    AxisLimits="-360 To 360",
    AxisLogicNumber="c",
    MovesRobot=Toggle(False),
    Set_Axis_Logic_Number=True,
    Set_Moves_Robot=True)
era = ExternalRotationalAxis(external_rotational_axis_2)
pln_6 = Plane(era)
pt_8 = Point(era)
vec_3 = Vector(era)
domain_2 = Domain(era)
bool_7 = Boolean(era)
num_5 = Number(era)
panel_77 = Panel(pt_8)
panel_78 = Panel(domain_2)
panel_79 = Panel(bool_7)
panel_80 = Panel(pln_6)
panel_81 = Panel(vec_3)
panel_82 = Panel(num_5)

# ----
# External Linear Axis
toggle_6 = BooleanToggle(False)
xy_9 = XYPlane(Origin=Point(0, 0, 0))
Z_2 = UnitZ(Factor=1)
external_linear_axis_2 = ExternalLinearAxis(
    Name="linear_axis",
    AttachmentPlane=xy_9,
    Axis=Z_2,
    AxisLimits="0 To 2000",
    AxisLogicNumber="b",
    MovesRobot=toggle_6,
    Set_Axis_Logic_Number=True,
    Set_Moves_Robot=True)
ela = ExternalLinearAxis(external_linear_axis_2)
vec_4 = Vector(ela)
domain_3 = Domain(ela)
bool_8 = Boolean(ela)
pln_7 = Plane(ela)
pt_9 = Point(ela)
num_6 = Number(ela)
crv = Curve(ela)
panel_83 = Panel(pln_7)
panel_84 = Panel(domain_3)
panel_85 = Panel(num_6)
panel_86 = Panel(pt_9)
panel_87 = Panel(vec_4)
panel_88 = Panel(bool_8)
panel_89 = Panel(crv)

# ----
# Practical example #1
panel_90 = Panel("LOCAL CONST jointtarget my_target := [[0, -45, 45, 0, 45, 0], [9E9, 9E9, 9E9, 9E9, 9E9, 9E9]];")
panel_91 = Panel("LOCAL CONST zonedata my_zone := [FALSE, 5, 8, 8, 0.8, 8, 0.8];")
list_4 = ValueList({"MoveAbsJ": 0, "MoveL": 1, "MoveJ": 2}, selected="MoveAbsJ")
M_2 = Move(
    Type=list_4,
    Target=panel_90,
    SpeedData="LOCAL CONST speeddata my_speed := [5, 500, 5000, 1000];",
    ZoneData=panel_91,
    Override_Robot_Tool=False,
    Override_Work_Object=False,
    Set_Circular_Point=False,
    Set_Digital_Output=False,
    Set_Movement_Time=False)
irb1600 = ABBIRB1600X145(PositionPlane=PlaneXY(0, 0, 0))
pv = PlaneVisualizer(Plane=M_2)
ik = InverseKinematics(Robot=irb1600, Movement=M_2, Closest_Robot_Joint_Position=False, Output_Posed_Meshes=False, Set_Hide_Mesh=False)  # -> RobotJointPosition, ExternalJointPosition
rg = RAPIDGenerator(
    Robot=irb1600,
    Action=M_2,
    Add_tooldata=False,
    Add_wobjdata=False,
    Module_Name=False,
    Output_tooldata=False,
    Output_wobjdata=False,
    Routine_Name=False)
panel_92 = Panel(rg)

# ----
# Practical example #4
button = Button()
getcont = GetController(Update=button, From_Menu=False)
timer = Timer(TimerInterval=20, Target=readrapid)  # disabled
readrapid = ReadRapidDomain(Controller=getcont, Task="T_ROB1", Module="MainModule", Symbol="my_robot_target")
rt_10 = RobotTarget(readrapid)

# ----
# Practical example #3
panel_93 = Panel("-90, -30, 30, 0, 0, 0")
jt_6 = JointTarget()
irb7600 = ABBIRB760034028(PositionPlane=PlaneXY(0, 0, 0))
merge_11 = Merge(Data1=jt_6, Data2=panel_93)
fk = ForwardKinematics(Robot=irb7600, RobotJointPosition=merge_11, Hide_Posed_Meshes=False, Output_Posed_Meshes=False)  # -> EndPlane, ExternalAxisPlanes

# ----
# Practical example #2
panel_94 = Panel("[[900.54, -843.13, 89.98], [0.707107, 0.707107, 0, 0], [0,0,0,0], [9E9, 9E9, 9E9, 9E9, 9E9, 9E9]]")
pt_10 = Point(Point(855.1384115, 1147.847858, 685.1009636))
flip_plane_y = FlipPlaneY(Plane=pt_10)
rt_11 = RobotTarget(
    Plane=flip_plane_y,
    AxisConfiguration=Slider(0, range=0..7),
    Set_External_Joint_Position=False,
    Set_Reference_Plane=False)
irb4600 = ABBIRB460040255(PositionPlane=PlaneXY(0, 0, 0))

# ----
# Pratical examples
merge_12 = Merge(Data1=rt_11, Data2=panel_94)

ik_2 = InverseKinematics(Robot=irb4600, Movement=merge_12, Closest_Robot_Joint_Position=False, Output_Posed_Meshes=False, Set_Hide_Mesh=False)  # -> RobotJointPosition, ExternalJointPosition
